% Simulink data dictionary sldemo_fuelsys_dd_types_float.sldd

u8En7 = Simulink.NumericType(DataTypeMode="Single", SignednessBool=true, WordLength=32, FixedExponent=0)
s16En3 = Simulink.NumericType(DataTypeMode="Single", SignednessBool=true, WordLength=32, FixedExponent=0)
s16En7 = Simulink.NumericType(DataTypeMode="Single", SignednessBool=true, WordLength=32, FixedExponent=0)
s16En15 = Simulink.NumericType(DataTypeMode="Single", SignednessBool=true, WordLength=32, FixedExponent=0)